# Dynamo graph Exporting Data to excel.dyn (Dynamo 2.3.0.5885)

# group: Input: Get all Types of doors in the project
# note: collect the category Doors
categories = Categories("OST_Doors")
# note: next we will collect all the element instances that have Doors as their category
all_elements_of_category = ElementsOfCategory(Category=categories)
# note: Each door instances has a type, and with this node we will find the type for each instance
elementType = Element.ElementType(element=all_elements_of_category)
# note: In the output of the previous list the types were repeated because we have more than one instance for some types. To avoid repeating types we use the node below
uniqueItems = List.UniqueItems(list=elementType)

# group: Get the Ids and the parameter value's
# note: Here we have a list of Parameters
# (as strings) that we want to get the
# values and export to excel
code_block = CodeBlock()
# ---------- code_block.designscript (6 lines) ----------
["Height",
"Width",
"Thickness",
"Description",
"Manufacturer",
"Cost"];
# ----------------------------------------
# note: Now that we have all the Door types, we want to find the Ids of these Door types. These Ids are unique and will be important to reinsert properly the data into the revit elements through the data import script.
id = Element.Id(element=uniqueItems)
# note: This node will get the value of the parameters we input as string (ParameterName).
getParameterValueByName = Element.GetParameterValueByName(parameterName=code_block, lacing=Longest)  # unwired: element
# note: This node will apply the fuction "GetParameterValueByName"
# to each element in the list of Door Types.
# The output will be a list where every sublist
# have all parameter values for each Door type
map = List.Map(list=uniqueItems, f_x=getParameterValueByName)

# group: creating header
code_block_2 = CodeBlock { "Id"; }
# note: We want to have Id as the
# first header as we are including
# its data in the first values sublist
addItemToFront = List.AddItemToFront(item=code_block_2, list=code_block)

# group: Inserting Ids into the list
# note: Transpose list, or in other words,
# swaps rows and columns .
# Now in each sublist we have
#  all values for each parameter
transpose = List.Transpose(lists=map)
# note: Add List of Ids as first sublist,
# togheter with the other
#  values we collected
addItemToFront_2 = List.AddItemToFront(item=id, list=transpose)
# note: we Transpose the list again.
# Now each sublist we have all
# parameters for a single
# Door Type once again
transpose_2 = List.Transpose(lists=addItemToFront_2)

# group: Exporting data
# note: Here we will browse the previously saved excel file.
# This entry must be filled in for the Script to succeed
file_path = Filename("..\..\..\..\..\Desktop\Exporting importing Data to excel.xlsx")
code_block_3 = CodeBlock()
# ---------- code_block_3.designscript (14 lines) ----------
// Use // to comment in Code Blocks

// In excel, what is the name
// f the Sheet Tab?
"Sheet1";

// We'll to start in cell A1,
// so we want to use 0 for both
// StartRow and StartCol(umn)
0;

// If there is already some data in
// the excel, we want to overwrite it
true;
# ----------------------------------------
# note: we add the headers as the
# first sublist in our data list
addItemToFront_3 = List.AddItemToFront(item=addItemToFront, list=transpose_2)
# note: This node will finally export our data to excel.
# Keep in mind data is written by row. In other words: our first sublist will be writen in the same row, the second sublist in the second row and so on.
exportExcel = Data.ExportExcel(filePath=file_path, sheetName=code_block_3.out0, startRow=code_block_3.out1, startCol=code_block_3.out1, data=addItemToFront_3, overWrite=code_block_3.out2)
