# Dynamo graph Importing Data from excel.dyn (Dynamo 2.10.1.3976)

# note: Process
# note: Creation and Retrieval of Data
# note: Element Creation
# note: User Selections + Setting Variables
# note: Output Data
# note: WIP

# group: Revit Selection
# note: Revit Input

# group: Visualization or Analysis
# note: Graphical Info

# group: Variables
# note: Num/Integer Sliders

# group: Dynamo Elements
# note: Dynamo Geometry

# group: Parameter Overrides
# note: Parameters

# group: Sorting Nodes
# note: Lists, filtering, sorting, separating, cleaning

# group: Revit Elements
# note: Revit Geometry

# group: Other Variables
# note: Other Input

# group: Output
# note: Write to: Excel, CSV, Etc.

# group: Database Sources
# note: Excel, CSV, Etc.

# group: Output
# note: WIP: Work in progress

# group: Input: Get all Types of doors in the project
# note: collect the category Doors
categories = Categories("OST_Doors")
# note: next we will collect all the element instances that have Doors as their category
all_elements_of_category = ElementsOfCategory(Category=categories)
# note: Each door instances has a type, and with this node we will find the type for each instance
elementType = Element.ElementType(element=all_elements_of_category)
# note: In the output of the previous list the types were repeated because we have more than one instance for some types. To avoid repeating types we use the node below
uniqueItems = List.UniqueItems(list=elementType)

# group: Getting the Id as String
# note: Get's the Id of each element
# We use this information as
# a reliable way to collect the
#  right elements in Revit
id = Element.Id(element=uniqueItems)
# note: To cross-reference the data and re-collect the Revit elements we need the Ids as strings, so we need to transform them from integers to strings.
# Notice below that the lists look the same, but when we connect the "Type" to them, we can see that the data types are different
string_from_object = FromObject(obj=id)
type = Object.Type(obj=id)
type_2 = Object.Type(obj=string_from_object)

# group: Input : Import Data from Excel
# note: Browser the excel file to get it's file path
file_path = Filename("..\OneDrive\Desktop\EXPORT_data to excel.xlsx")
# note: Using the file path,
# gets the file as object
file_from_path = FileObject(path=file_path)
code_block = CodeBlock()
# ---------- code_block.designscript (9 lines) ----------
// Use // to comment in Code Blocks
// In excel, what is the name of the Sheet Tab?
"Sheet1";

//if we set false, the data will NOT be transformed into strings.
//That is, integers will be imported as integers and so on
true;
// Do we want to open the excel as we import the data?
true;
# ----------------------------------------
# note: Read data from excel (by row).
# If excel is open, it will be read and closed without saving
importExcel = Data.ImportExcel(file=file_from_path, sheetName=code_block.out0, readAsStrings=code_block.out1, showExcel=code_block.out2)

# group: Formatting data as we need
# note: Divide our imported data into first list from the previous node (Headers) and the rest (parameter values updated)
deconstruct = List.Deconstruct(list=importExcel)
# note: swaps rows and columns
transpose = List.Transpose(lists=deconstruct.rest)

# group: Get Revit elements with the excel Element.Ids order
code_block_2 = CodeBlock(x=transpose)
# ---------- code_block_2.designscript (3 lines) ----------
//Let's get just the first list,
//as it has the Id values
x[0];
# ----------------------------------------
# note: Here is ace in the hole:
# For each of the Ids we import from Excel, we want to list the Revit elements IN THE SAME ORDER, so that the data is inserted into the correct element, EVEN IF THE ORDER HAS CHANGED, OR NEW ELEMENTS HAVE BEEN ADDED.
# So for each element in excel we will return its index in the list of elements found in Revit
indexOf = List.IndexOf(list=string_from_object, element=code_block_2)
# note: Now that we know the correct index of each element, we just need to get them in their index
getItemAtIndex = List.GetItemAtIndex(list=uniqueItems, index=indexOf@L1)
type_3 = Object.Type(obj=code_block_2)

# group: Getting values for each parameter
code_block_3 = CodeBlock()
# ---------- code_block_3.designscript (4 lines) ----------
//Parameters we want to update
["Description",
"Manufacturer",
"Cost"];
# ----------------------------------------
# note: As in the previous step, we need to identify where in the list the items we want are located. We are looking for the parameters we want in the excel header.
indexOf_2 = List.IndexOf(list=deconstruct.first, element=code_block_3)
# note: With the index we can get the data for each parameter in the transposed list (this means that we are, from each sublist, getting the values for each column in excel)
getItemAtIndex_2 = List.GetItemAtIndex(list=transpose, index=indexOf_2)

# group: Formatting Storage Type
# note: function to be applied along the list: convert to number
toNumber = String.ToNumber()  # unwired: str
# note: transform items with only numbers into numbers.
# Items that contain any character other than a number will return null.
map = List.Map(list=getItemAtIndex_2, f_x=toNumber)
# note: function to be applied along the list: determine if the item is null
isNull = Object.IsNull()  # unwired: object
# note: We will change the values by those previously found whenever the values of String.ToNumber have null results
replaceByCondition = Replace(item=map, replaceWith=getItemAtIndex_2, condition=isNull)

# group: Set Parameter
# note: Door Family types in the same order of their ids appear in excel
watch = Watch(getItemAtIndex)
# note: Number os items in the Door types list
count = List.Count(list=getItemAtIndex)
# note: let's repeat the list of parameters to be inserted in each of the doors
ofRepeatedItem = List.OfRepeatedItem(item=code_block_3, amount=count)
# note: We will transpose the list to have, in each sublist, the values for each parameter
transpose_2 = List.Transpose(lists=replaceByCondition)
setParameterByName = Element.SetParameterByName(element=watch, parameterName=ofRepeatedItem, value=transpose_2)

# note: INPUT:
# OUTPUT:
# note: USING PYTHON
#  ✔️ The Above Nove Already contains the boiler plate
#  ✔️ Always use a description with your Python Nodes, as above
python_script = Python()  # IronPython2; unwired: IN[0]
# ---------- python_script.python (41 lines) ----------
import clr #This is .NET's Common Language Runtime. It's an execution environment
#that is able to execute code from several different languages.
import sys #sys is a fundamental Python library - here, we're using it to load in
#the standard IronPython libraries
sys.path.append('C:\Program Files (x86)\IronPython 2.7\Lib') #Imports the
#standard IronPython libraries, which cover everything from servers and
#encryption through to regular expressions.
import System #The System namespace at the root of .NET
from System import Array #.NET class for handling array information
from System.Collections.Generic import * #Lets you handle generics. Revit's API
#sometimes wants hard-typed 'generic' lists, called ILists. If you don't need
#these you can delete this line.
clr.AddReference('ProtoGeometry')  #A Dynamo library for its proxy geometry
#classes. You'll only need this if you're interacting with geometry.
from Autodesk.DesignScript.Geometry import * #Loads everything in Dynamo's
#geometry library
clr.AddReference("RevitNodes") #Dynamo's nodes for Revit
import Revit #Loads in the Revit namespace in RevitNodes
clr.ImportExtensions(Revit.Elements) #More loading of Dynamo's Revit libraries
clr.ImportExtensions(Revit.GeometryConversion) #More loading of Dynamo's
#Revit libraries. You'll only need this if you're interacting with geometry.
clr.AddReference("RevitServices") #Dynamo's classes for handling Revit documents
import RevitServices 
from RevitServices.Persistence import DocumentManager #An internal Dynamo class
#that keeps track of the document that Dynamo is currently attached to
from RevitServices.Transactions import TransactionManager #A Dynamo class for
#opening and closing transactions to change the Revit document's database

clr.AddReference("RevitAPI") #Adding reference to Revit's API DLLs
clr.AddReference("RevitAPIUI") #Adding reference to Revit's API DLLs

import Autodesk #Loads the Autodesk namespace
from Autodesk.Revit.DB import * #Loading Revit's API classes
from Autodesk.Revit.UI import * #Loading Revit's API UI classes  

doc = DocumentManager.Instance.CurrentDBDocument #Finally, setting up handles to the active Revit document
uiapp = DocumentManager.Instance.CurrentUIApplication #Setting a handle to the active Revit UI document
app = uiapp.Application  #Setting a handle to the currently-open instance of the Revit application
uidoc = uiapp.ActiveUIDocument #Setting a handle to the currently-open instance of the Revit UI application

#######OK NOW YOU CAN CODE########
# ----------------------------------------
# note: GRAPH INFO
# Company: CES
# Dynamo version: 2.0.4
# Revit Version: 2019.2
useful_links_ctrl_click_on_link = CodeBlock { "https://forum.dynamobim.com/"; }

# group: Input: Get all Types of doors in the project
# note: collect the category Doors
categories_2 = Categories("OST_Doors")
# note: next we will collect all the element instances that have Doors as their category
all_elements_of_category_2 = ElementsOfCategory(Category=categories_2)
# note: Each door instances has a type, and with this node we will find the type for each instance
elementType_2 = Element.ElementType(element=all_elements_of_category_2)
# note: In the output of the previous list the types were repeated because we have more than one instance for some types. To avoid repeating types we use the node below
uniqueItems_2 = List.UniqueItems(list=elementType_2)

code_block_4 = CodeBlock(x=uniqueItems_2) { x[0]; }
parameters = Element.Parameters(element=code_block_4)
code_block_5 = CodeBlock(x=parameters) { x.Name; }
storageType = Parameter.StorageType(parameter=parameters)
byKeysValues = DesignScript.Builtin.Dictionary.ByKeysValues(keys=code_block_5, values=storageType)
