# Dynamo graph 02_FileInformation.dyn "02_File Information" (Dynamo 2.3.1.11775)
# packages: Clockwork for Dynamo 2.x 2.3.0, spring nodes 110.0.2

# group: File Version
# note: Custom Node: Clockwork v.1.0.3
version = Custom[Application.Version]()  # package Clockwork for Dynamo 2.x; Retrieves the name, version and build of the current Revit application.

# group: File Size
current = Document.Current()
filePath = Document.FilePath(document=current)
# note: Custom Node: spring nodes v.204.1.0
size = Custom[Springs.File.Size](path=filePath)  # package spring nodes; Outputs the the file size in kilobytes or megabytes. Provide a file path as a string. Set kbOnly to true for a consistent output.
