# Dynamo graph 04_In-PlaceFamilesAndGenericModels.dyn "04_In-Place Familes and Generic Models" (Dynamo 2.3.1.11775)
# packages: Bakery 2019.5.8

# group: In-Place Families
# note: Custom Node: Bakery v.2019.5.8
report_on_inplace_families = Custom[Report on Inplace Families]()  # package Bakery
count = List.Count(list=report_on_inplace_families.inplace_families)

# group: Generic Models
categories = Categories("OST_GenericModel")  # graph input
all_elements_of_category = ElementsOfCategory(Category=categories)
count_2 = List.Count(list=all_elements_of_category)
