# Dynamo graph 07_Views.dyn (Dynamo 2.3.1.11775)

# group: Views
categories = Categories("OST_Views")
all_elements_of_category = ElementsOfCategory(Category=categories)
isNull = Object.IsNull(obj=all_elements_of_category)
filterByBoolMask = List.FilterByBoolMask(list=all_elements_of_category, mask=isNull)
count = List.Count(list=filterByBoolMask.out)

# group: Views not Placed on Sheets
categories_2 = Categories("OST_Views")
all_elements_of_category_2 = ElementsOfCategory(Category=categories_2)
isNull_2 = Object.IsNull(obj=all_elements_of_category_2)
filterByBoolMask_2 = List.FilterByBoolMask(list=all_elements_of_category_2, mask=isNull_2)
code_block = CodeBlock { "Sheet Number"; }
getParameterValueByName = Element.GetParameterValueByName(element=filterByBoolMask_2.out, parameterName=code_block)
code_block_2 = CodeBlock { "---"; }
eq = getParameterValueByName == code_block_2
filterByBoolMask_3 = List.FilterByBoolMask(list=getParameterValueByName, mask=eq)
count_2 = List.Count(list=filterByBoolMask_3.in)
